# Dynamo graph ABG_190422_ViewsToSheets.dyn "View Creation" (Dynamo 2.3.0.5885)
# packages: archi-lab.net 2021.25.21

file_path = Filename("No file selected.")  # graph input
file_from_path = FileObject(path=file_path)
sheet_name = StringInput("")  # graph input
code_block = CodeBlock { true; false; }
importExcel = Data.ImportExcel(file=file_from_path, sheetName=sheet_name, readAsStrings=code_block.out0, showExcel=code_block.out1)
drop_header_rows = IntegerSlider(1, range=0..100 step 1)  # graph input
dropItems = List.DropItems(list=importExcel, amount=drop_header_rows)
transpose = List.Transpose(lists=dropItems)
code_block_2 = CodeBlock { 0; 1; }
getItemAtIndex = List.GetItemAtIndex(list=transpose, index=code_block_2.out1)
getItemAtIndex_2 = List.GetItemAtIndex(list=transpose, index=code_block_2.out0)
# note: Custom Node: archilab v.2021.25.21
createPlaceholder = archilab.Revit.Views.Sheets.CreatePlaceholder(number=getItemAtIndex, name=getItemAtIndex_2)
setParameterByName = Element.SetParameterByName(element=createPlaceholder, lacing=Shortest)  # unwired: parameterName, value
code_block_3 = CodeBlock { 0; 2; }
getItemAtIndex_3 = List.GetItemAtIndex(list=importExcel, index=code_block_3.out0)
dropItems_2 = List.DropItems(list=getItemAtIndex_3, amount=code_block_3.out1)
dropItems_3 = List.DropItems(list=transpose, amount=code_block_3.out1)
combine = List.Combine(comb=setParameterByName, list1=dropItems_2, list2=dropItems_3)
